# Dynamo graph Sample.dyn (Dynamo 2.0.1.5055)

code_block = CodeBlock { 10; 5; 1; 1; 1; }
byCoordinates = Point.ByCoordinates()
family_types = FamilyTypes(index=15)
byData = FIllingSpaceForZeiss.Zeiss.ZeissBoothData.ByData(lengthX=code_block.out0, lengthY=code_block.out1, numberOfRoofSpaces=code_block.out2, roofDirection=byCoordinates, minimumMZ5Size=code_block.out3, minimumBlendenSize=code_block.out4, blendTypes=family_types)
byData_2 = FIllingSpaceForZeiss.Zeiss.Floor.Properties.FloorProperties.ByData(data=byData)
family_types_2 = FamilyTypes(index=161)
code_block_2 = CodeBlock { 1; }
byCoordinates_2 = Point.ByCoordinates(x=code_block_2)
code_block_3 = CodeBlock { 0.2; 0.1; 0.05; 0.19; 2; }
byData_3 = FIllingSpaceForZeiss.Zeiss.Floor.Properties.FlakeboardStripesProperties.ByData(floorData=byData_2, flakeboardType=family_types_2, flakeBoardDirection=byCoordinates_2, desiredAccrossFlakeboardDistance=code_block_3.out0, flakeboardDistanceToBounds=code_block_3.out1, flakeboardDistanceAlong=code_block_3.out2, flakeboardWidth=code_block_3.out3, flakeboardLength=code_block_3.out4)
createFlakeboardStripes = FIllingSpaceForZeiss.Zeiss.Floor.FloorGenerator.CreateFlakeboardStripes(props=byData_3)
levels = Levels(index=0)
count = List.Count(list=createFlakeboardStripes.points)
ofRepeatedItem = List.OfRepeatedItem(item=levels, amount=count)
create = FIllingSpaceForZeiss.DynamoUtils.FamilyHelper.Create(type=createFlakeboardStripes.familyTypes, level=ofRepeatedItem, position=createFlakeboardStripes.points, rotation=createFlakeboardStripes.rotation, length=createFlakeboardStripes.lengths, width=createFlakeboardStripes.widths)
byData_4 = FIllingSpaceForZeiss.Zeiss.Floor.Properties.FlakeboardPlatesProperties.ByData()  # unwired: floorData, flakeboardType, distanceToBorder, direction, plateLength, minPlateLength, plateWidth, zOffset
